# Grasshopper definition AutoZonerABTester.gh (Grasshopper 1.0.7)
# plug-ins: ClimateStudioGH, Writer

series = Series(Start=0, Step="1/24 * 2*pi", Count="8760")
expression = Expression(x=series, Expression="-cos(x)*0.5+0.5")
year_schedule = ConstructCSYearSchedule(Name="Sinusoid", Type=0, Category=0, DaysHours=expression)  # -> Sched, Values

ventilationperperson_l_s_person = Slider(10, range=0..10)
ventilationperarea_l_s_m2 = Slider(0.6, range=0..5)
coolingsetpoint_degc = Slider(24, range=16..30)
heatingsetpoint_degc = Slider(18, range=10..24)
econ = ValueList({"NoEconomizer", "DifferentialEnthalpy"}, selected="NoEconomizer")
mechventon = BooleanToggle(True)
hrv = ValueList({"None", "Sensible", "Enthalpy"}, selected="None")

infiltrationmethod = ValueList({"ACH", "Flow Per Exterior Area": "FlowExtArea"}, selected="Flow Per Exterior Area")
infiltration_m3_s_m2 = Slider(0.0005, range=0..0.0005)
infiltration_ach = Slider(0, range=0..1)

# ---- group: Loads
lpd_w_m2 = Slider(10, range=0..50)
epd_w_m2 = Slider(6, range=0..50)
peopledensity_ppl_m2 = Slider(0.025, range=0..0.5)

# ----
wwr = Slider(50, range=10..90)

# ----
# Unit Converter
# Internalized Geometry is
# modeled in meters.
toggle = BooleanToggle(True)
unit = CSUnitScale(
    From="Meters",
    To="ActiveRhinoDocUnits",
    Listener=toggle,
    Input_0_Hidden=False,
    Input_0_Name="From",
    Input_1_Hidden=False,
    Input_1_Name="To",
    Input_2_Hidden=False,
    Input_2_Name="Listener",
    UnitSystem=4)

# ---- group: Geometry
n_floors = Slider(3, range=0..30)
x_axis_meters = Panel("12")
y_axis_meters = Panel("12")
perim_offset = Panel("4")
f2f_height_meters = Panel("4")
multiplication = Multiplication(A=f2f_height_meters, B=unit)
multiplication_2 = Multiplication(A=x_axis_meters, B=unit)
multiplication_3 = Multiplication(A=y_axis_meters, B=unit)
multiplication_4 = Multiplication(A=perim_offset, B=unit)

# ---- group: Windows
number_slider = Slider(0.75, range=0..1)
number_slider_2 = Slider(1, range=0.6..7)
tvis = Panel("0.75")

# ----
# RUN
button = Button()

# ---- group: Roof
list = ValueList({"UVal_0.4", "UVal_0.3", "UVal_0.2", "UVal_0.1"}, selected="UVal_0.3")
list_2 = ValueList({"Light": "_Light", "Mass": "_Mass"}, selected="Light")

# ---- group: Facade
list_3 = ValueList({"UVal_0.4", "UVal_0.3", "UVal_0.2", "UVal_0.1"}, selected="UVal_0.3")
list_4 = ValueList({"Light": "_Light", "Mass": "_Mass"}, selected="Light")

# ---- group: Ground Slab
list_5 = ValueList({"UVal_0.4", "UVal_0.3", "UVal_0.2", "UVal_0.1"}, selected="UVal_0.3")
list_6 = ValueList({"Light": "_Light", "Mass": "_Mass"}, selected="Light")

# ---- group: Weather File
path = FilePath("C:\ProgramData\Solemma\Common\WeatherData\EPW\USA_NY_New.York-LaGuardia.AP.725030_TMYx.2004-2018.epw")

# ---- group: MechVentilationSchedule
sched = GetCSYearSchedule(UnitSystem=4)
panel = Panel("AllOn")

# ----
wwr_n = Number(wwr)
merge = Merge(Data1=list, Data2=list_2)
merge_2 = Merge(Data1=list_3, Data2=list_4)
merge_3 = Merge(Data1=list_5, Data2=list_6)
list_7 = ValueList({"Residential", "Kitchen", "Office", "MeetingRoom", "HotelRoom", "ClassRoom", "Library", "LectureHall", "SuperMarket", "Shopping", "ScienceLab"}, selected="Office")
simple_window = ConstructCSSimpleWindow(Name="SimpleWindowConstruction", Shgf=number_slider, Uval=number_slider_2, Tvis=tvis)
merge_4 = Merge(Data1=wwr_n, Data2=wwr_n, Data3=wwr_n, Data4=wwr_n)  # -> simplify(flatten(Result))
zonetemplate = GetZoneTemplate(SearchZoneTemplate=list_7, Selection="Office")
join = TextJoin(Text=merge)
heating_coolingconstant = BooleanToggle(True)
join_2 = TextJoin(Text=merge_2)
scheduledventilationon = BooleanToggle(False)
join_3 = TextJoin(Text=merge_3)
people_equip_lightson = BooleanToggle(True)

panel_2 = Panel("Airspeed 0")
sched_2 = GetCSYearSchedule(UnitSystem=4)

heating_coolingon = BooleanToggle(True)
humidistaton = BooleanToggle(True)
infiltrationon = BooleanToggle(True)

sched_3 = GetCSYearSchedule(UnitSystem=4)

item = ListItem(List=zonetemplate, Index=0, Wrap=True)
fanenergy = BooleanToggle(False)
shadingon = BooleanToggle(False)
hasframe = BooleanToggle(False)
dhwon = BooleanToggle(False)
dhwon_2 = BooleanToggle(False)
construction = GetCSConstruction(SearchConstructions=join)
construction_2 = GetCSConstruction(SearchConstructions=join_2)
construction_3 = GetCSConstruction(SearchConstructions=join_3)
dimmingtype = Panel("Off")
cluster = Cluster_3(numfloors=n_floors, floorheight=multiplication, xlen=multiplication_2, ylen=multiplication_3, offset=multiplication_4)  # -> floorzaxismovementvec, perimnames, perimeter_2, core_names, f2fzaxismovementvec, core_2, footprintbasecurve, ground_plane_2
explode = Explode(Curve=cluster.footprintbasecurve, Recursive=True)  # -> Segments, Vertices
extr = Extrude(Base=explode.Segments, Direction=cluster.f2fzaxismovementvec)  # -> graft(Extrusion)
move = Move(Geometry=extr, Motion=cluster.floorzaxismovementvec)  # -> simplify(flatten(Geometry)), Transform
winshdgen = WinShdGen(zone_geometry=move.Geometry, wwr=merge_4)
zset = CSZoneSettings(
    Name="ParametricZoneSettings",
    ZoneSettings=item,
    RoofConstruction=construction,
    FacadeConstruction=construction_2,
    SlabConstruction=construction_3,
    ExternalFloorConstruction=construction_3,
    GroundSlabConstruction=construction_3,
    PeopleDensity=peopledensity_ppl_m2,
    AirspeedSchedule=sched_2,
    EquipmentPowerDensity=epd_w_m2,
    LightingPowerDensity=lpd_w_m2,
    OccupancySchedule=year_schedule.Sched,
    EquipmentAvailabilitySchedule=year_schedule.Sched,
    LightsAvailabilitySchedule=year_schedule.Sched,
    DimmingType=dimmingtype,
    PeopleIsOn=people_equip_lightson,
    EquipmentIsOn=people_equip_lightson,
    LightsIsOn=people_equip_lightson,
    CoolingCOP=Slider(1, range=0.6..6),
    HeatingCOP=Slider(1, range=0.6..6),
    HeatingSetpoint=heatingsetpoint_degc,
    CoolingSetpoint=coolingsetpoint_degc,
    HeatingSetpointConstant=heating_coolingconstant,
    CoolingSetpointConstant=heating_coolingconstant,
    HeatIsOn=heating_coolingon,
    CoolIsOn=heating_coolingon,
    MechVentIsOn=mechventon,
    HumidistatIsOn=humidistaton,
    HeatingLimitType="NoLimit",
    CoolingLimitType="NoLimit",
    HeatingSchedule=sched_3,
    CoolingSchedule=sched_3,
    MechVentSchedule=year_schedule.Sched,
    MinFreshAirPerson=ventilationperperson_l_s_person,
    MinFreshAirArea=ventilationperarea_l_s_m2,
    EconomizerType=econ,
    HeatRecoveryType=hrv,
    HeatRecoveryEfficiencySensible="0.7",
    HeatRecoveryEfficiencyLatent="0.65",
    MinHumidity="20",
    MaxHumidity="80",
    TurnOnEMSFanEnergy=fanenergy,
    MaxHeatSupplyAirTemp="30",
    MinCoolSupplyAirTemp="18",
    NatVentIsOn=dhwon,
    SchedVentIsOn=scheduledventilationon,
    InfiltrationIsOn=infiltrationon,
    InfiltrationAch=infiltration_ach,
    InfiltrationFlowExtArea=infiltration_m3_s_m2,
    InfiltrationCalculationMethod=infiltrationmethod,
    DHWOn=dhwon_2,
    Input_0_Hidden=False,
    Input_0_Name="Name",
    Input_100_Hidden=True,
    Input_100_Name="Interior Vertical Insulation Depth",
    Input_101_Hidden=True,
    Input_101_Name="Exterior Horizontal Insulation Depth",
    Input_102_Hidden=True,
    Input_102_Name="Exterior Horizontal Insulation Width",
    Input_103_Hidden=True,
    Input_103_Name="Footing Thickness",
    Input_104_Hidden=True,
    Input_104_Name="Footing Depth",
    Input_105_Hidden=True,
    Input_105_Name="ElectricityCO2",
    Input_106_Hidden=True,
    Input_106_Name="ElectricityCost",
    Input_107_Hidden=True,
    Input_107_Name="HotWaterCO2",
    Input_108_Hidden=True,
    Input_108_Name="HotWaterCost",
    Input_109_Hidden=True,
    Input_109_Name="CoolingCO2",
    Input_10_Hidden=True,
    Input_10_Name="Ground Wall Construction",
    Input_110_Hidden=True,
    Input_110_Name="HeatingCO2",
    Input_111_Hidden=True,
    Input_111_Name="CoolingCost",
    Input_112_Hidden=True,
    Input_112_Name="HeatingCost"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)
windows = Geometry(winshdgen)
wset = CSWindowSettings(
    Name="SimpleWindowSettings",
    Type="External",
    ShadingSystemIsOn=shadingon,
    GlazingConstruction=simple_window,
    OperableArea="0",
    HasFrame=hasframe,
    AFNWindowAvailability="AllOff",
    Input_0_Hidden=False,
    Input_0_Name="Name",
    Input_10_Hidden=True,
    Input_10_Name="ShadingThickness",
    Input_11_Hidden=True,
    Input_11_Name="ShadeGlassDistance",
    Input_12_Hidden=True,
    Input_12_Name="TopBottomEdgeOpeningMultiplier",
    Input_13_Hidden=True,
    Input_13_Name="Analysis Mesh Resolution",
    Input_14_Hidden=True,
    Input_14_Name="ZoneMixingIsOn",
    Input_15_Hidden=True,
    Input_15_Name="ZoneMixingDeltaTemperature",
    Input_16_Hidden=True,
    Input_16_Name="ZoneMixingFlowRate",
    Input_17_Hidden=False,
    Input_17_Name="Glazing Construction",
    Input_18_Hidden=False,
    Input_18_Name="OperableArea",
    Input_19_Hidden=True,
    Input_19_Name="ZoneMixingAvailibilitySchedule",
    Input_1_Hidden=False,
    Input_1_Name="WindowSettings",
    Input_20_Hidden=False,
    Input_20_Name="HasFrame",
    Input_21_Hidden=True,
    Input_21_Name="FrameWidth",
    Input_22_Hidden=True,
    Input_22_Name="FrameProjection"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)

# ----
# Model Setup
library = CSLibrary(AddObjects=flatten([year_schedule.Sched, simple_window]))
zone = CSEnergyZone(
    Brep=cluster.core_2,
    Name=cluster.core_names,
    Settings=zset,
    UsedLibraryObjects="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")  # -> Zones, Settings
zone_2 = CSEnergyZone(
    Brep=cluster.perimeter_2,
    Name=cluster.perimnames,
    Settings=zset,
    UsedLibraryObjects="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")  # -> Zones, Settings
bco = CSBoundaryObject(Brep=cluster.ground_plane_2, type="GROUND")
window = CSWindow(Surface=windows, Settings=wset, UsedLibraryObjects="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")  # -> Window, Settings
model = CSModelMaker(Zones=flatten([zone.Zones, zone_2.Zones]), Windows=window.Window, Boundaries=bco, Library=library)  # -> Model, Invalid
run_e = RunCSEnergyModel(
    Model=model.Model,
    Name="Autozoner",
    Location=path,
    Run=button,
    NorthOffset=0,
    settings="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")  # -> Model, Settings, Result

toggle_2 = BooleanToggle(True)
load_zone_results = LoadCSZoneResults(
    ThermalModel=run_e.Model,
    Toggle=toggle_2,
    byzone="True",
    settings="""{
  "zoneIDs": [],
  "output2Display": [
    {
      "key": "Zone Ideal Loads Supply Air Total Heating Energy",
      "unit": "HVAC Sum [J]",
      "type": 0
    }
  ],
  "normalizeByFloorArea": false
}""")  # -> ResultsPerZone, Labels, Name, Zone
load_zone_results_2 = LoadCSZoneResults(
    ThermalModel=run_e.Model,
    Toggle=toggle_2,
    byzone="True",
    settings="""{
  "zoneIDs": [],
  "output2Display": [
    {
      "key": "Zone Ideal Loads Supply Air Total Cooling Energy",
      "unit": "HVAC Sum [J]",
      "type": 0
    }
  ],
  "normalizeByFloorArea": false
}""")  # -> ResultsPerZone, Labels, Name, Zone
debrep = DeconstructBrep(Brep=load_zone_results_2.Zone)  # -> Faces, Edges, Vertices
item_2 = ListItem(List=debrep.Faces, Index="5", Wrap=True)  # -> graft(Item)
area = Area(Geometry=item_2)  # -> simplify(Area), Centroid
pow = Power(A="10", B="-7")
multiplication_5 = Multiplication(A="2.777", B=pow)
energy_results = LoadCSEnergyResult(ThermalModel=run_e.Model, Mode=0, Resolution=0, Toggle=Toggle(True))  # -> TotalEUI, Baseline, TotalCO2, TotalCost, FloorArea, Data, Labels, Months, Colors, CSR
multiplication_6 = Multiplication(A=load_zone_results_2.ResultsPerZone, B=multiplication_5)
multiplication_7 = Multiplication(A=load_zone_results.ResultsPerZone, B=multiplication_5)
division = Division(A=multiplication_6, B=area.Area)
division_2 = Division(A=multiplication_7, B=area.Area)
plotter = CSPlotter(
    Type=0,
    Width=550,
    Height=450,
    Title="Monthly EUI By End Use",
    Y_title="kWh/m2",
    X_labels=energy_results.Months,
    X_rot=0,
    Y_data=energy_results.Data,
    Colors=energy_results.Colors,
    Names=energy_results.Labels,
    Show_xgrid=False,
    Show_ygrid=True,
    Legend=0,
    PreviewDimension=1,
    InfinateZoomDisplay=True,
    UnitSystem=4)
writer = Writer()
merge_5 = Merge(
    Data1=ColourSwatch(SwatchColor=RGB(255, 0, 0)),
    Data2=ColourSwatch(SwatchColor=RGB(0, 255, 0)),
    Data3=ColourSwatch(SwatchColor=RGB(0, 123, 255)),
    Data4=ColourSwatch(SwatchColor=RGB(234, 255, 0)),
    Data5=ColourSwatch(SwatchColor=RGB(225, 0, 255)))
stack = StackData(Data=merge_5, Stack=Slider(3, range=0..10))
plotter_2 = CSPlotter(
    Type=0,
    Width=550,
    Height=450,
    X_rot=0,
    Y_data=division,
    Colors=stack,
    Names=load_zone_results_2.Name,
    Show_xgrid=False,
    Show_ygrid=True,
    Legend=0,
    PreviewDimension=1,
    InfinateZoomDisplay=True,
    UnitSystem=4)
plotter_3 = CSPlotter(
    Type=0,
    Width=550,
    Height=450,
    X_rot=0,
    Y_data=division_2,
    Colors=stack,
    Names=load_zone_results_2.Name,
    Show_xgrid=False,
    Show_ygrid=True,
    Legend=0,
    PreviewDimension=1,
    InfinateZoomDisplay=True,
    UnitSystem=4)
ma = MassAddition(Input=division)  # -> flatten(Result), PartialResults
series_2 = Series(Start=0, Step=1, Count="15")
ma_2 = MassAddition(Input=division_2)  # -> flatten(Result), PartialResults
plotter_4 = CSPlotter(
    Type=1,
    Width=550,
    Height=450,
    X_data=series_2,
    X_labels=load_zone_results_2.Name,
    X_rot=90,
    Y_data=ma_2.Result,
    Colors=stack,
    Show_xgrid=False,
    Show_ygrid=True,
    Legend=0,
    PreviewDimension=1,
    InfinateZoomDisplay=True,
    UnitSystem=4)
plotter_5 = CSPlotter(
    Type=1,
    Width=550,
    Height=450,
    X_data=series_2,
    X_labels=load_zone_results_2.Name,
    X_rot=90,
    Y_data=ma.Result,
    Colors=stack,
    Show_xgrid=False,
    Show_ygrid=True,
    Legend=0,
    PreviewDimension=1,
    InfinateZoomDisplay=True,
    UnitSystem=4)

# ==== cluster WinShdGen
zone_geometry = ClusterInput()
debrep = DeconstructBrep(ZoneGeometry=zone_geometry)  # -> Faces, Edges, Vertices
area = Area(Geometry=debrep.Faces)  # -> Area, Centroid
evalsrf = EvaluateSurface(Surface=debrep.Faces, Point=area.Centroid)  # -> Point, Normal, UDirection, VDirection, Frame
Z = UnitZ(Factor=1)
dprod = DotProduct(VectorA=evalsrf.Normal, VectorB=Z, Unitize=False)
wwr = ClusterInput()  # WWR (N,E,S,W)
abs = Absolute(Value=dprod)
smaller = SmallerThan(FirstNumber=abs, SecondNumber=".9")  # -> SmallerThan, OrEqualTo
dispatch = Dispatch(List=debrep.Faces, DispatchPattern=smaller.SmallerThan)  # -> ListA, ListB
srf = Surface(dispatch.ListA)
cluster = Cluster_2(srf=srf)
srf_2 = Surface(flatten(cluster))
item = ListItem(List=wwr, Index="0", Wrap=True)
item_2 = ListItem(List=wwr, Index="1", Wrap=True)
item_3 = ListItem(List=wwr, Index="2", Wrap=True)
item_4 = ListItem(List=wwr, Index="3", Wrap=True)
Y = UnitY(Factor=1)
X = UnitX(Factor=1)
Y_2 = UnitY(Factor="-1")
X_2 = UnitX(Factor="-1")
cluster_2 = Cluster(S=srf, dir=X, wwr=item_2)
cluster_3 = Cluster(S=srf, dir=Y_2, wwr=item_3)
cluster_4 = Cluster(S=srf, dir=X_2, wwr=item_4)
cluster_5 = Cluster(S=srf, dir=Y, wwr=item)
geo_n = Geometry(cluster_5)
geo_e = Geometry(cluster_2)
geo_s = Geometry(cluster_3)
geo_w = Geometry(cluster_4)
merge = Merge(Data1=geo_n, Data2=geo_e, Data3=geo_s, Data4=geo_w)
clean = CleanTree(RemoveNulls=True, RemoveInvalid=True, RemoveEmpty=False, Tree=merge)  # -> flatten(Tree)
T = ClusterOutput(clean)

# ==== cluster Cluster_3
floorheight = ClusterInput()
numfloors = ClusterInput()
xlen = ClusterInput()
ylen = ClusterInput()
offset = ClusterInput()

numfloors_2 = Number(numfloors)
floorheight_2 = Number(floorheight)
xlen_2 = Number(xlen)
ylen_2 = Number(ylen)
xy = XYPlane(Origin=Point(0, 0, 0))
Z = UnitZ(Factor=expr("x*0.5", floorheight_2))
footprintcurve = Rectangle(Plane=xy, XSize=xlen_2, YSize=ylen_2, Radius=0)  # -> FootprintBaseCurve, Length
Z_2 = UnitZ(Factor=floorheight_2)
move = Move(Geometry=xy, Motion=Z)  # -> Geometry, Transform
az = Autozoner(FloorPlanOutlines=footprintcurve.FootprintBaseCurve, Offset=offset)  # -> Outline, PerimeterPolylines, CorePolylines, SkeletonPolylines
box = CenterBox(Base=move.Geometry, X=xlen_2, Y=ylen_2, Z=expr("x*0.5", floorheight_2))
series = Series(Start=0, Step=floorheight_2, Count=numfloors_2)
pcol = PolylineCollapse(Polyline=az.PerimeterPolylines, Tolerance=1)  # -> Polyline, Count
pcol_2 = PolylineCollapse(Polyline=az.CorePolylines, Tolerance=1)  # -> Polyline, Count
floorzmove = UnitZ(Factor=series)
extr = Extrude(Base=pcol.Polyline, Direction=Z_2)
extr_2 = Extrude(Base=pcol_2.Polyline, Direction=Z_2)
cap = CapHoles(Brep=extr_2)
cap_2 = CapHoles(Brep=extr)  # -> graft(Brep)
move_2 = Move(Geometry=cap_2, Motion=floorzmove)  # -> Geometry, Transform
move_3 = Move(Geometry=cap, Motion=floorzmove)  # -> Geometry, Transform
ground_plane = Surface(footprintcurve.FootprintBaseCurve)
perimeter = Geometry(move_2.Geometry)
core = Geometry(move_3.Geometry)

footprintbasecurve = ClusterOutput(footprintcurve.FootprintBaseCurve)
f2fzaxismovementvec = ClusterOutput(Z_2)
floorzaxismovementvec = ClusterOutput(floorzmove)
ground_plane_2 = ClusterOutput(ground_plane)
perimeter_2 = ClusterOutput(perimeter)
core_2 = ClusterOutput(core)
panel = Panel("""South
East
North
West""")
series_2 = Series(Start=0, Step=1, Count=numfloors_2)
ins = InsertItems(List=graft(series_2), Item="Core", Indices=0, Wrap=True)  # -> simplify(List)
stack = StackData(Data=graft(panel), Stack=numfloors_2)
stack_2 = StackData(Data=graft(series_2), Stack="4")
join = TextJoin(Text=ins, Join="_Level_")  # -> flatten(Core_Names)
panel_2 = Panel(stack)
flip = FlipMatrix(Data=stack_2)
panel_3 = Panel(flip)
core_names = ClusterOutput(join)
merge = Merge(Data1=simplify(graft(panel_2)), Data2=simplify(graft(panel_3)))
join_2 = TextJoin(Text=merge, Join="_Level_")
panel_4 = Panel(join_2)
trim = TrimTree(Tree=panel_4, Depth="1")
perimnames = ClusterOutput(trim)

# ==== cluster Cluster
wwr = ClusterInput()  # WWR
dir = ClusterInput()  # Dir
S = ClusterInput()  # S

# ----
# north south gets priority
Y = UnitY(Factor=1)
dprod = DotProduct(VectorA=dir, VectorB=Y, Unitize=False)
abs = Absolute(Value=dprod)
int = Integer(abs)
item = ListItem(List=[".71", ".7"], Index=int, Wrap=True)

area = Area(Geometry=S)  # -> Area, Centroid
evalsrf = EvaluateSurface(Surface=S, Point=area.Centroid)  # -> Point, Normal, UDirection, VDirection, Frame
dprod_2 = DotProduct(VectorA=evalsrf.Normal, VectorB=dir, Unitize=False)
larger = LargerThan(FirstNumber=dprod_2, SecondNumber=item)  # -> LargerThan, OrEqualTo
panel = Panel(evalsrf.Normal)
dispatch = Dispatch(List=S, DispatchPattern=larger.LargerThan)  # -> WallsNORTH, ListB
wall_geometry = Geometry(dispatch.WallsNORTH)

# ---- group: User-Defined WWR Scale
division = Division(NorthScaleInput=wwr, B="100")

# ---- group: Centroids of Walls
area_2 = Area(Geometry=wall_geometry)  # -> Area, Centroid

# ----
sqrt = SquareRoot(Value=division)
scale = Scale(Geometry=wall_geometry, Center=area_2.Centroid, Factor=sqrt)  # -> flatten(NORTHWindows), Transform
area_3 = Area(Geometry=scale.NORTHWindows)  # -> Area, Centroid; disabled
division_2 = Division(A=area_3.Area, B=area_2.Area)  # disabled
panel_2 = Panel(division_2)  # disabled
north_windows = ClusterOutput(scale.NORTHWindows)

# ==== cluster Cluster_2
srf = ClusterInput()
srf_2 = Surface(srf)
crv = Curve(srf_2)
crv_2 = Curve(srf_2)  # disabled
srf_3 = Surface(crv_2)  # disabled
area = Area(Geometry=srf_2)  # -> Area, Centroid; disabled
srf_4 = Surface(crv)
area_2 = Area(Geometry=srf_3)  # -> Area, Centroid; disabled
flip = Flip(Surface=srf_4, Guide=srf_2)  # -> Surface, Result
evalsrf = EvaluateSurface(Surface=srf_2, Point=area.Centroid)  # -> Point, Normal, UDirection, VDirection, Frame; disabled
evalsrf_2 = EvaluateSurface(Surface=srf_3, Point=area_2.Centroid)  # -> Point, Normal, UDirection, VDirection, Frame; disabled
panel = Panel(flip.Result)
vdis = VectorDisplay(Anchor=area_2.Centroid)  # disabled
dprod = DotProduct(VectorA=evalsrf.Normal, VectorB=evalsrf_2.Normal, Unitize=False)  # disabled
vdis_2 = VectorDisplay(Anchor=area.Centroid, Vector=expr("x*10", evalsrf.Normal))  # disabled
panel_2 = Panel(".9")  # disabled
smaller = SmallerThan(FirstNumber=dprod, SecondNumber=panel_2)  # -> SmallerThan, OrEqualTo; disabled
dispatch = Dispatch(List=srf_3, DispatchPattern=smaller.SmallerThan)  # -> ListA, ListB; disabled
flip_2 = Flip(Surface=dispatch.ListA)  # -> Surface, Result; disabled
srf_5 = Surface(flatten([flip_2.Surface, dispatch.ListB]))  # disabled
S = ClusterOutput(flip.Surface)
